# Grasshopper definition CS_00_intro.gh (Grasshopper 1.0.7)
# Copyright: Co-de-iT

# Rhino/GH developer docs
# C# component
# https://developer.rhino3d.com/ - Rhino developer home page
# 
# https://developer.rhino3d.com/api/ - API references
# 
# http://developer.rhino3d.com/guides/rhinocommon/what-is-rhinocommon/
# 
# https://developer.rhino3d.com/api/RhinoCommon - RhinoCommon SDK
# 
# https://developer.rhino3d.com/api/grasshopper - Grasshopper SDK
# warning/error messages
# and results of Print() function
# outputs
# inputs
# double-click
# to open editor
# right-click to
# set output name
# 
# zoom in
# to add or remove
# right-click to
# set input name,
# type and structure
# 
# zoom in
# to add or remove
# C# references
# https://msdn.microsoft.com/en-gb/library/67ef8sbd.aspx - C# programming guide
# 
# https://www.rhino3d.com/download/rhino/6/essential-csharp-scripting-grasshopper
c_script = CSharpScript()  # -> Out, A
# Reflect()
mesh = Mesh(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)
crv = Curve(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)
# sum of 2 numbers
pt = Point(Point(0, 0, 0))
# CS_00_intro
# 
# C# - intro definition
# 
# code by Alessio Erioli
# 
# v 0.1
# © Co-de-iT 2020 / Creative Commons Attribution-Non Commercial-ShareAlike 4.0 International License
# not Hello World (but sort of)
panel = Panel("<input your name>")
# create Point
number_slider = Slider(47.361, range=0..100)
# create Polyline/NURBS curve
number_slider_2 = Slider(0, range=0..100)
pt_2 = Point([Point(-10.44971177, -16.09633362, 0), Point(-38.18687341, 24.18943046, 0), Point(-4.694320715, 66.12353854, 0), Point(62.94356935, 64.88826719, 0), Point(85.96513356, 6.512157948, 0), Point(67.87676168, -34.18667877, 0)])
data = Data()
c_script_2 = CSharpScript(P=pt_2, deg=Slider(3, range=1..5), periodic=Toggle(False))  # -> out, Pl, C; inputs P: list of Point3d, deg: Int32, periodic: Boolean
# ---------- c_script_2: C# ----------
    Pl = new Polyline(P);
    C = NurbsCurve.Create(periodic, deg, P);
# ---------- end c_script_2 ----------
c_script_3 = CSharpScript(A=Slider(25.915, range=0..100), B=Slider(63.292, range=0..100))  # -> out, S; inputs A: Double, B: Double
# ---------- c_script_3: C# ----------
    S = A + B;

    Print("The sum of A and B is {0}", A+B);
# ---------- end c_script_3 ----------
c_script_4 = CSharpScript(x=number_slider, y=Slider(47.361, range=0..100), z=number_slider_2)  # -> out, A; inputs x: Double, y: Double, z: Double
# ---------- c_script_4: C# ----------
    A = new Point3d(x, y, z);
# ---------- end c_script_4 ----------
c_script_5 = CSharpScript(x=panel, y="<input your age>")  # -> out, A
# ---------- c_script_5: C# ----------
    Print("Hello {0}, 'tis a fine day to learn C#!\n\nAnd at the tender age of {1}!", x, y);
# ---------- end c_script_5 ----------
c_script_6 = CSharpScript(x=data)  # -> out, A
# ---------- c_script_6: C# ----------
    Reflect(x);
# ---------- end c_script_6 ----------
panel_2 = Panel(c_script_5.out)
panel_3 = Panel(c_script_6.out)
panel_4 = Panel(c_script_3.out)
panel_5 = Panel(c_script_3.S)
pt_3 = Point(c_script_4.A)
crv_2 = Curve(c_script_2.Pl)
crv_3 = Curve(c_script_2.C)
