# Grasshopper definition CS_01_data 01.gh (Grasshopper 1.0.7)
# Copyright: Co-de-iT

c_script = CSharpScript()  # -> out, A, B, C, D
# ---------- c_script: C# ----------
    int myInt = 5;
    double myDouble = 3.14;
    bool myBool = true;
    string myString = "Did you know the name 'Grasshopper' actually comes from Grace Hopper?";
    
    A = myInt;
    B = myDouble;
    C = myBool;
    D = myString;

    Print("this message goes on the 'out' output param");
# ---------- end c_script ----------
c_script_2 = CSharpScript()  # -> out, A, B, C, D
# ---------- c_script_2: C# ----------
    // declare a single dimensional array
    int[] array1 = new int[5];

    // set values
    array1[0] = 6;
    array1[1] = 74;
    array1[2] = 2;
    array1[3] = 83;
    array1[4] = 9;

    // retrieve an element
    int value_A = array1[1];
    A = value_A;

    // length of an array (n. of elements)
    B = array1.Length;

    // declare and set values
    int[] array1d1 = new int[] { 1, 3, 5, 7, 9 };

    // shorter syntax
    int[] array1d2 = { 1, 2, 3, 4, 5, 6 };

    // two dimensional array
    int[,] mdArray1 = new int[2, 3];

    // declare and set values
    int[,] mdlArray2 = { { 1, 2, 3 }, { 4, 5, 6 } };

    // jagged array
    int[][] arrayJag = new int[4][];
    arrayJag[0] = new int[]{1,2,3};
    arrayJag[1] = new int[]{4,5,6,7};
    arrayJag[2] = new int[]{6,7};
    arrayJag[3] = new int[]{8,9,10,11};

    C = arrayJag.Length;
    
    D = arrayJag[0].Length;
# ---------- end c_script_2 ----------
c_script_3 = CSharpScript()  # -> out, A, B, C
# ---------- c_script_3: C# ----------
    // declare and instantiate a List
    List<Point3d> listName = new List<Point3d>();


    // add elements to the list

    Point3d pt0 = new Point3d(0.0, 0.0, 0.0);
    listName.Add(pt0);

    Point3d pt1 = new Point3d(1.0, 0.0, 0.0);
    listName.Add(pt1);

    Point3d pt2 = new Point3d(2.0, 0.0, 0.0);
    listName.Add(pt2);


    // count elements in the list
    A = listName.Count;

    // output the list
    B = listName;

    // retrieve the i-est element of the list
    Point3d ptOut = listName[0];
    C = ptOut;
# ---------- end c_script_3 ----------
# lists
panel = Panel(c_script_3.A)
panel_2 = Panel(c_script_3.B)
panel_3 = Panel(c_script_3.C)
# CS_01_data 01
# 
# Variables and data structures in C# - arrays and lists
# 
# code by Alessio Erioli
# 
# v 0.1
# variables
panel_4 = Panel(c_script.out)
int = Integer(c_script.A)
num = Number(c_script.B)
bool = Boolean(c_script.C)
panel_5 = Panel(c_script.D)
# arrays
panel_6 = Panel(c_script_2.A)
panel_7 = Panel(c_script_2.B)
panel_8 = Panel(c_script_2.C)
panel_9 = Panel(c_script_2.D)
panel_10 = Panel(bool)
panel_11 = Panel(num)
# © Co-de-iT 2020 / Creative Commons Attribution-Non Commercial-ShareAlike 4.0 International License
# + addition
# - subtraction
# * multiplication
# / division
# 
# % modulus
# 
# += add to self
# -= subtract from self
# *= multiply by self
# /= divide by self
# ++ add 1 to self
# 
# < smaller than
# > larger than
# <= smaller than or equal to
# >= larger than or equal to
# == equals
# && AND operator
# || OR operator
# != NOT operator
panel_12 = Panel(int)
# value type
c_script_4 = CSharpScript(x=Slider(0.414, range=0..1))  # -> out, A, B; inputs x: Double
# ---------- c_script_4: C# ----------
    double b;

    // double is a value type
    // each instance is stored in a unique memory location
    b = x;
    x += 2;
    
    // changing the value of x does not affect b

    A = x;
    B = b;
# ---------- end c_script_4 ----------
# reference type
c_script_5 = CSharpScript(x=Slider(0, range=0..10))  # -> out, A, B; inputs x: Double
# ---------- c_script_5: C# ----------
    MySphere s1,s2;

    s1 = new MySphere(new Point3d(x, 0, 0), 1.0);
    s2 = s1;
    // MySphere, as all newly declared classes, is a reference type
    // s1 points to a specific memory location, a copy will point to that same location
    s1.center += new Point3d(0.5, 0, 0);
    // changing s1 center affects s2 as well

    A = s1.geom();
    B = s2.geom();
# ---------- c_script_5: C# additional code ----------
  public class MySphere
  {
    public double rad;
    public Point3d center;

    public MySphere(Point3d center, double rad)
    {
      this.center = center;
      this.rad = rad;
    }

    public Sphere geom()
    {
      return new Sphere(center, rad);
    }

  }
# ---------- end c_script_5 ----------
panel_13 = Panel(c_script_4.B)
panel_14 = Panel(c_script_4.A)
srf = Surface(c_script_5.A)
srf_2 = Surface(c_script_5.B)
# operators
timer = Timer(TimerInterval=500, Target=[c_script_6, c_script_7])  # disabled
reset = BooleanToggle(True)
c_script_6 = CSharpScript(reset=reset)  # -> out, C; inputs reset: Boolean
# ---------- c_script_6: C# ----------
    if (reset) count = 0;
    C = count++;
# ---------- c_script_6: C# additional code ----------
  int count;
# ---------- end c_script_6 ----------
# persistent vs volatile data
c_script_7 = CSharpScript()  # -> out, C
# ---------- c_script_7: C# ----------
    int count = 0;
    C = count++; // try ++count
# ---------- end c_script_7 ----------
panel_15 = Panel(c_script_7.C)
panel_16 = Panel(c_script_6.C)
