# Grasshopper definition CS_06_delegates + lambda expression.gh (Grasshopper 1.0.7)
# Copyright: Co-de-iT

# Lambda expression (anonymous function)
# parameter
# s  =>  { return s*2; }
number_slider = Slider(1, range=0..2)
# lambda operator
# function body
# (a,b)  => { return a+b; }
# Lambda expression allows writing anonymous functions (functions without signature, to be implemented and executed on the fly).
# 
# Example:
# 
# int Sum (int a, int b)
# {
#   return a+b;
# }
# 
# becomes:
# 
# (a,b) => {return a+b;}
# 
# The function body can also have multiple lines and complex instructions.
number_slider_2 = Slider(2, range=0..2)
# What are delegates and what do they do?
# 
# Double click on the C# component and find out!
c_script = CSharpScript(x=number_slider, y=number_slider_2)  # -> out, A; inputs x: Double, y: Double
# ---------- c_script: C# ----------
    // dealing with delegates
    // start from the additional code below

    Foo(ComputeAverage, x, y); // this will pass the ComputeAverage function as parameter
    Foo(ComputeSquaredSum, x, y); // this will pass the ComputeSquaredSum function as parameter

    // a delegate is a data type, so I can use it to define variables, just as I do with classes
    // (i.e. if I define a class Ball the I can instantiate a Ball b = new Ball(<params>))
    // in the case of delegates, variables should be existing functions with matching signatures
    BinaryOperator myFavoriteBinaryOperator = ComputeAverage;
    BinaryOperator yourFavoriteBinaryOperator = ComputeSquaredSum;

    Foo(myFavoriteBinaryOperator, x, y);
    Foo(yourFavoriteBinaryOperator, x, y);

    // I can also use an anonymous function as a parameter for the delegate
    // provided that it has the same signature
    // C# automatically assumes that a,b are doubles but I have to return a double as well
    Foo((a, b) => {return a + b;}, x, y);
# ---------- c_script: C# additional code ----------
  // delegate declaration
  // delegate <type> <name>(<parameters>);
  delegate double BinaryOperator(double a, double b);

  // define functions with matching signature with the delegate
  // (in this case: 2 doubles as params, returning one double)

  double ComputeAverage (double first, double second)
  {
    return (first + second) * 0.5;
  }

  double ComputeSquaredSum(double m, double n)
  {
    return (m + n) * (m + n);
  }

  // define a function that has the delegate as a parameter
  void Foo(BinaryOperator bOperator, double a, double b)
  {
    double result = bOperator(a, b);
    Print(result.ToString());
  }
# ---------- end c_script ----------
# CS_06_delegates + lambda expression
# 
# using delegates - a practical example + lambda expression
# 
# code by Alessio Erioli - from an example by Long Nguyen
# 
# v 0.1
# © Co-de-iT 2020 / Creative Commons Attribution-Non Commercial-ShareAlike 4.0 International License
panel = Panel(c_script.out)
