# Grasshopper definition CS_08_using Linq.gh (Grasshopper 1.0.7)
# Copyright: Co-de-iT

# https://www.tutorialsteacher.com/linq/linq-tutorials
# 
# in particular:
# 
# https://www.tutorialsteacher.com/linq/linq-query-syntax
# https://www.tutorialsteacher.com/linq/linq-method-syntax
# https://www.tutorialsteacher.com/linq/linq-lambda-expression
# https://www.tutorialsteacher.com/linq/linq-standard-query-operators
# basic LINQ Query Synthax: from <range variable> in <IEnumerable<T> or IQueryable<T> Collection>
# 
# <Standard Query Operators> <conditional expression>
# 
# <select or groupBy operator> <result formation>
# Query synthax - example in C#: // string collection
# List<string> stringList = new List<string> {
#     "C# Tutorials",
#     "VB.NET Tutorials",
#     "Learn C++",
#     "MVC Tutorials" ,
#     "Java"
# };
# 
# // LINQ Query Syntax
# var result = from s in stringList
#             where s.Contains("Tutorials")
#             select s;
panel = Panel("""C# Tutorials
VB.NET Tutorials
Learn C++
MVC Tutorials
Java""")
# Method synthax - example in C#: // string collection
# List<string> stringList = new List<string> {
#     "C# Tutorials",
#     "VB.NET Tutorials",
#     "Learn C++",
#     "MVC Tutorials" ,
#     "Java"
# };
# 
# // LINQ Query Syntax
# var result = stringList.Where(s => s.Contains("Tutorials"));
# s  =>  s.Contains("Tutorials")
# multiple parameters and multiple statements in lambda expression body: (s, youngAge) =>
# {
#   Console.WriteLine("Lambda expression with multiple statements in the body");
# 
#   Return s.Age >= youngAge;
# }
panel_2 = Panel("""C# Tutorials
VB.NET Tutorials
Learn C++
MVC Tutorials
Java""")
c_script = CSharpScript(S=panel, f="Tutorials")  # -> out, A; inputs S: list of String, f: String
# ---------- c_script: C# usings ----------
using System.Linq;
# ---------- c_script: C# ----------
    // LINQ Query Syntax
    var result = from s in S
        where s.Contains(f)
        select s;

    A = result;
# ---------- end c_script ----------
c_script_2 = CSharpScript(S=panel_2, f="Tutorials")  # -> out, A; inputs S: list of String, f: String
# ---------- c_script_2: C# ----------
    // LINQ Method Syntax
    var result = S.Where(s => s.Contains(f));

    A = result;
# ---------- end c_script_2 ----------
# Multi-Threading
# 
# Multi-Threading, Linq and GH_ types
# 
# © a3 _/TH.esis 2020 _ Creative Commons Attribution-NonCommercial-ShareAlike3.0 UnportedLicense.
# CS_08_using Linq
# 
# Linq syntax for queries - usage examples
# 
# code by Alessio Erioli
# 
# v 0.1
# © Co-de-iT 2020 / Creative Commons Attribution-Non Commercial-ShareAlike 4.0 International License
panel_3 = Panel(c_script.A)
panel_4 = Panel(c_script_2.A)

# ---- group: generate permutations
series = Series(Start=0, Step=1, Count=Slider(4, range=1..4))
crossref = CrossReference(ListA=series, ListB=series, CrossMode=1)  # -> ListA, ListB
concat = Concatenate(FragmentA=crossref.ListB, FragmentB=",", FragmentC=crossref.ListA)  # -> flatten(Result)

# ----
panel_5 = Panel(concat)
# LINQ examples
c_script_3 = CSharpScript(n=Slider(100, range=1..100), S=concat)  # -> out, A, B, C, D, E, F; inputs n: Int32, S: list of String
# ---------- c_script_3: C# ----------
                                                            /*
   System.Linq examples

  the basic lambda synthax is <var> => <anonymous expression with var>

  basic Linq functions:

  Where(<var> => <filtering condition with var>)
  Select(<var> => <expression with var>)
  Sum(<var> => <expression with var>)

   */

    int[] array = new int[n];
    int[] array2 = new int[array.Length];



    List<int> aList = new List<int>();

    // filling the array and list with the index itself
    for(int i = 0; i < array.Length; i++)
    {
      array[i] = i;
      aList.Add(i);
    }

    // filling the array and list with the index itself - the Linq way
    array = array.Select(i => i).ToArray();

    // generating an array of 1s
    array2 = array.Select(i => 1).ToArray();
    //aList = array.Select(i => 1).ToList(); // remember conversions ToArray and ToList

    // . . . . extracting only even numbers

    // extended synthax
    //A = from i in array where(i % 2 == 0) select(i);

    // lambda synthax
    A = array.Where(i => i % 2 == 0);

    // . . . . sum of all numbers
    B = array.Sum(i => i);

    // . . . . sum of all odd numbers
    C = array.Where(i => i % 2 != 0).Sum(i => i);

    // . . . . use in a function
    D = ConvertToGHInt(aList);

    E = ToDataTree(ConvertStringToInt(S));

    F = array.Where(i => i > n*0.5).FirstOrDefault();
# ---------- c_script_3: C# additional code ----------
  public List<GH_Integer> ConvertToGHInt(List<int> list)
  {
    if (list == null) return null;
    else
      return list.Select(c => new GH_Integer(c)).ToList();
  }


  public int[][] ConvertStringToInt(List<String> Sc)
  {
    int[][] selCells = new int[Sc.Count][];

    for (int i = 0; i < Sc.Count; i++)
      selCells[i] = Sc[i].Split(',').Select(sd => Convert.ToInt32(sd)).ToArray();

    return selCells;
  }

  DataTree<GH_Integer> ToDataTree(int[][] array)
  {
    DataTree<GH_Integer> tOut = new DataTree<GH_Integer>();

    for(int i = 0; i < array.Length; i++)
      tOut.AddRange(array[i].Select(k => new GH_Integer(k)), new GH_Path(i));

    return tOut;
  }
# ---------- end c_script_3 ----------
gh_integer_list = Panel(c_script_3.D)
just_even_numbers = Panel(c_script_3.A)
sum_total = Panel(c_script_3.B)
sum_of_odd_numbers = Panel(c_script_3.C)
string_to_datatree_integers = Panel(c_script_3.E)
panel_6 = Panel(c_script_3.F)
